# Grasshopper definition hydrobot4.gh (Grasshopper 0.9.76)

pt = ConstructPoint(XCoordinate=0, YCoordinate=0, ZCoordinate=0)
circle = CircleCNR(Center=pt, Normal=Vector(0, 0, 1), Radius=Slider(3, range=0..10))
_500mm = Panel("500")
crv = Curve(<curve referenced from the Rhino model>)
area = Area(Geometry=circle)  # -> Area, Centroid
number_slider = Slider(4, range=0..10)
number_slider_2 = Slider(3, range=0..10)
boundary = BoundarySurfaces(Edges=crv)
series = Series(Start=0, Step=Slider(6, range=0..10), Count=Slider(5, range=0..10))
multiplication = Multiplication(A=area.Area, B=_500mm)
panel = Panel(multiplication)
offset = Offset(Curve=boundary, Distance=series, Plane=PlaneXY(0, 0, 0), Corners=1)  # -> flatten(Curve)
pt_2 = ConstructPoint(XCoordinate=0, YCoordinate=0, ZCoordinate=0)
divide = DivideCurve(Curve=reparameterize(offset), Count=Slider(93, range=0..1000), Kinks=False)  # -> flatten(Points), Tangents, Parameters
height_of_3d_printed_formwork = Panel("15")

# ---- group: Red-extruder 01
srf = Surface(boundary)

# ----
points = PointList(Points=divide.Points, Size=Slider(2, range=0..10))
area_2 = Area(Geometry=srf)  # -> Area, Centroid

# ---- group: for every what mm cubed = to length of extrusion
volume_to_be_calculate_through_experimen = Panel("14138")  # "volume to be calculate through experiment (mm cubed)"
length_mm_500mm_per_minute = Panel("500")

# ----
multiplication_2 = Multiplication(A=area_2.Area, B=height_of_3d_printed_formwork)
feed_rate = Panel("500")
mm_cubed = Panel(multiplication_2)
Y = UnitY(Factor=1)
num = Number(feed_rate)
area_3 = Area(Geometry=srf)  # -> Area, Centroid
preview = CustomPreview(Geometry=srf, Shader=ColourSwatch(SwatchColor=RGB(87, 181, 0)))
reverse_extrude_not_to_drip = Panel("1")
pt_3 = Point(area_3.Centroid)

# ---- group: simple proportion
# initial extrude:
# 
# 1. make sure pipe is full
# 
#       2. use extruder to control flow
# 
# the rest is controlled by the servo(might be messy) to would need some retraction
eval = Evaluate(F="(a/b)*c", a=multiplication_2, b=volume_to_be_calculate_through_experimen, c=length_mm_500mm_per_minute)

# ---- group: shift first
shift = ShiftList(List=pt_3, Shift=1, Wrap=invert(True))

# ---- group: POSITION OF NOZZLE ACCORDINGLY
move = Move(Geometry=area_3.Centroid, Motion=Y)  # -> Geometry, Transform

# ---- group: shift last
shift_2 = ShiftList(List=pt_3, Shift=-1, Wrap=invert(True))

# ----
points_2 = PointList(Points=area_3.Centroid, Size=Slider(23, range=0..100))
lengths_of_extrusion = Panel(eval)
num_2 = Number(reverse_extrude_not_to_drip)

# ---- group: fills pipe at zero point
# this needs to be converted into time for stepper with given speed
pt_4 = ConstructPoint(XCoordinate=0, YCoordinate=0, ZCoordinate=0)

# ----
dist = Distance(PointA=shift_2, PointB=shift)
pline = PolyLine(Vertices=[shift_2, shift], Closed=False)
panel_2 = Panel(dist)
# volume to length formula: 2000 mm cubed = 34 mm
# 
# // change according to pump
division = Division(A=eval, B=Slider(71, range=0..100))
num_3 = Number(division)
pdecon = Deconstruct(Point=divide.Points)  # -> XComponent, YComponent, ZComponent
eval_2 = Evaluate(F="Format(\"{0:G1 X0.00 }{1:Y0.00 }{2:Z-0.00 }\",x,y,z)", x=pdecon.XComponent, y=pdecon.YComponent, z=num_2)
panel_3 = Panel(pdecon.XComponent)
rep = ReplaceText(Text=eval_2, Find="Z", Replace="E", RecursiveReplace=False)
eval_3 = Evaluate(F="Format(\"{0:G1 X0.00 }{1:Y0.00 }{2:Z0.00 }\",x,y,e)", x=pdecon.XComponent, y=pdecon.YComponent, e=num_3)  # -> graft(Result)
eval_4 = Evaluate(F="Format(\"{0:G1 Z0.00 }{1:F0 }\",z,f)", z=num_3, f=Slider(800, range=0..1000))  # -> graft(Result)
# M280 PX SX whenever you want to control your servos (P for selecting your servo number and S for the position of it).
# M280 P0 S180
# M280 P0 S-180
rep_2 = ReplaceText(Text=eval_3, Find="Z", Replace="E", RecursiveReplace=False)
graft = GraftTree(Tree=num_3, IncludeEmptyLists=True, IncludeNullItems=True)
panel_4 = Panel("http://reprap.org/wiki/G-code")
panel_5 = Panel(rep_2)
rep_3 = ReplaceString(String=rep_2, Find="-G1 X", Replace="G1 X-", RecursiveReplace=False)
rep_4 = ReplaceString(String=rep_3, Find="-Y", Replace="Y-", RecursiveReplace=False)
simplify = SimplifyTree(Tree=flatten(rep_4), Front=False)
feedrate = Slider(1000, range=0..1500)
partition = PartitionList(List=simplify, Size="2")  # -> simplify(graft(Chunks))
power_of_vibration = Slider(50, range=0..255)
prefix_gcode = Panel(""";code generated for hydrotiles
;by grass hopper

G28 X0 Y0
G90
G21""")
postfix_gcode = Panel("G28")
flatten = FlattenTree(Tree=partition, Path="{0}")

# ---- group: Vibrating table
eval_5 = Evaluate(F="Format(\"M106 {0:S0 }\", s)", s=power_of_vibration)

# ----
panel_6 = Panel(flatten)
eval_6 = Evaluate(F="Format(\"G1 {0: F0}\", f)", f=feedrate)
panel_7 = Panel(eval_5)
panel_8 = Panel("Format(\"{0:G1 X0.00 }{1:Y0.00 }{2:Z0.00 }\",x,y,z)")
merge = Merge(Data1=prefix_gcode, Data2=postfix_gcode, Data3=eval_5, Data4=eval_6, Data5=flatten, Data6="M106 S0", Data7="G28 X0 Y0")
panel_9 = Panel(merge)
